# Dynamo graph IEdata_END.dyn (Dynamo 2.1.0.7500)

file_path = Filename("D:\Book1.xlsx")
sheetname_2 = StringInput("Sheet1")
code_block = CodeBlock { 0; 6; }
file_path_2 = Filename(".\IN.xlsx")  # graph input
file_from_path = FileObject(path=file_path_2)
sheetName = StringInput("Sheet1")  # graph input
importExcel = Data.ImportExcel(file=file_from_path, sheetName=sheetName)
restOfItems = List.RestOfItems(list=importExcel)
transpose = List.Transpose(lists=restOfItems)
code_block_2 = CodeBlock(x=transpose) { x[5]; }
code_block_3 = CodeBlock(x=transpose) { x[3]; }
text_filter = StringInput("C")  # graph input
uniqueItems = List.UniqueItems(list=code_block_2)
list_sort___phase = List.Sort(list=uniqueItems)
python_script = Python(IN[0]=code_block_2, IN[1]=code_block_3, IN[2]=text_filter, IN[3]=list_sort___phase)
# ---------- python_script.python (43 lines) ----------
import clr
clr.AddReference('ProtoGeometry')
from Autodesk.DesignScript.Geometry import *
#The inputs to this node will be stored as a list in the IN variables.
element = IN[0]
type = IN[1]
textSort  = IN[2]
phase = IN[3]

k = []
OCCelement = []

"""
for i,t in enumerate(type):
	if IN[2] in t and element[i] == IN[3]:
		OCCelement.append(type[i])
"""

""" A = A + A
for m in range(len(phase)): 
	for i,t in enumerate(type):
		if IN[2] in t and element[i] == phase[m]:
			OCCelement.append(type[i])
	k.append(len(OCCelement))
"""
"""
for m in range(len(phase)): 
	for i,t in enumerate(type):
		if IN[2] in t and element[i] == phase[m]:
			OCCelement.append(type[i])
	k.append(len(OCCelement))
"""

def enums(element, textSort, type, phase):
	for m in range(len(phase)): 
		for i,t in enumerate(type):
			if textSort in t and element[i] == phase[m]:
				OCCelement.append(type[i])
		k.append(len(OCCelement))
	return k

#Assign your output to the OUT variable.
OUT = enums(element, textSort, type, phase)
# ----------------------------------------
count_c_gb_b_sp_hp = Python(IN[0]=python_script)
# ---------- count_c_gb_b_sp_hp.python (12 lines) ----------
lst = IN[0]
def countLst(lst):
    output = []
    output.append(lst[0])
    
    for m in range(len(lst)-1):
        a = lst[m+1]-lst[m]
        output.append(a)
    return output


OUT = countLst(lst)
# ----------------------------------------
boolean = BoolSelector(false)
exportExcel = Data.ExportExcel(filePath=file_path, sheetName=sheetname_2, startRow=code_block.out0, startCol=code_block.out1, data=count_c_gb_b_sp_hp, overWrite=boolean)
list_create = List.Create(item0=code_block_3, item1=code_block_2)
transpose_2 = List.Transpose(lists=list_create)
text_filter_2 = StringInput("C")  # graph input

# group: CHECK
string = StringInput("1-1工区0S")
python_script_2 = Python(IN[0]=code_block_2, IN[1]=code_block_3, IN[2]=text_filter_2, IN[3]=string)
# ---------- python_script_2.python (32 lines) ----------
import clr
clr.AddReference('ProtoGeometry')
from Autodesk.DesignScript.Geometry import *
#The inputs to this node will be stored as a list in the IN variables.
element = IN[0]
type = IN[1]
colums  = IN[2]
phase = IN[3]

k = []
OCCelement = []

for i,t in enumerate(type):
	if IN[2] in t and element[i] == IN[3]:
		OCCelement.append(type[i])


""" A = A + A
for m in range(len(phase)): 
	for i,t in enumerate(type):
		if IN[2] in t and element[i] == phase[m]:
			OCCelement.append(type[i])
	k.append(len(OCCelement))

for m in range(len(phase)): 
	for i,t in enumerate(type):
		if IN[2] in t and element[i] == phase[m]:
			OCCelement.append(type[i])
	k.append(len(OCCelement))
"""
#Assign your output to the OUT variable.
OUT = OCCelement
# ----------------------------------------
