# Dynamo graph IEdata_Test.dyn (Dynamo 2.3.0.5885)

file_path = Filename("D:\Book1.xlsx")
string = StringInput("Sheet1")
code_block = CodeBlock { 0; 6; }
boolean = BoolSelector(false)
exportExcel = Data.ExportExcel(filePath=file_path, sheetName=string, startRow=code_block.out0, startCol=code_block.out1, overWrite=boolean)  # unwired: data
file_path_2 = Filename("D:\DTD Assembly Schedule.xlsx")
file_from_path = FileObject(path=file_path_2)
string_2 = StringInput("DTD Assembly Schedule")
importExcel = Data.ImportExcel(file=file_from_path, sheetName=string_2)
restOfItems = List.RestOfItems(list=importExcel)
transpose = List.Transpose(lists=restOfItems)
code_block_2 = CodeBlock(x=transpose) { x[3]; }
code_block_3 = CodeBlock(x=transpose) { x[5]; }
list_create = List.Create(item0=code_block_2, item1=code_block_3)
transpose_2 = List.Transpose(lists=list_create)
string_3 = StringInput("C")
uniqueItems = List.UniqueItems(list=code_block_3)
sort = List.Sort(list=uniqueItems)
python_script = Python(IN[0]=code_block_3, IN[1]=code_block_2, IN[2]=string_3, IN[3]=sort)
# ---------- python_script.python (33 lines) ----------
import clr
clr.AddReference('ProtoGeometry')
from Autodesk.DesignScript.Geometry import *
#The inputs to this node will be stored as a list in the IN variables.
element = IN[0]
type = IN[1]
colums  = IN[2]
phase = IN[3]

k = []
OCCelement = []

"""
for i,t in enumerate(type):
	if IN[2] in t and element[i] == IN[3]:
		OCCelement.append(type[i])
"""

""" A = A + A
for m in range(len(phase)): 
	for i,t in enumerate(type):
		if IN[2] in t and element[i] == phase[m]:
			OCCelement.append(type[i])
	k.append(len(OCCelement))
"""
for m in range(len(phase)): 
	for i,t in enumerate(type):
		if IN[2] in t and element[i] == phase[m]:
			OCCelement.append(type[i])
	k.append(len(OCCelement))

#Assign your output to the OUT variable.
OUT = k
# ----------------------------------------
count = List.Count(list=python_script)
